# Grasshopper definition 01_0_outdoor_airflow.gh (Grasshopper 1.0.4)

panel = Panel("""20
60
20""")
panel_2 = Panel("""0.1
0.3
0.6""")
panel_3 = Panel("""0.5
0.5""")
panel_4 = Panel("""70
30""")
brep = Brep([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])
# This file is set up in meters. If you're using a different units make sure to scale the input geometries.
wires = BrepWireframe(Brep=brep, Density=-1)
seggrading = Butterfly_SegmentGrading(percentageLength=panel_2, percentageCells=panel, expansionRatio=1)  # -> segmentGrading; plug-in component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
seggrading_2 = Butterfly_SegmentGrading(percentageLength=panel_3, percentageCells=panel_4, expansionRatio=1)  # -> segmentGrading; plug-in component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
bbox = BoundingBox(Content=brep, Plane=PlaneXY(0, 0, 0), UnionBox=True)  # -> Box, Box_2
volume = Volume(Geometry=bbox.Box_2)  # -> Volume, Centroid
number_slider = Slider(1.5, range=0..10)
wall = Butterfly_WallBoundary()  # -> wallBoundary; plug-in component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
project = Project(Geometry=volume.Centroid, Plane=PlaneXY(0, 0, 0))  # -> Geometry, Transform
inoutrefmode = Butterfly_LocationRefinementMode(mode=0, level="3")  # -> locationRefMode; plug-in component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
multigrading = Butterfly_MultiGrading(segmentGradings=flatten(seggrading))  # -> grading; plug-in component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
multigrading_2 = Butterfly_MultiGrading(segmentGradings=flatten(seggrading_2))  # -> grading; plug-in component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
scale_nu = ScaleNU(Geometry=bbox.Box_2, Plane=project.Geometry, ScaleX=number_slider, ScaleY=number_slider, ScaleZ=number_slider)  # -> Geometry, Transform
# 0. BUTTERFLY GEOMETRIES
panel_5 = Panel("buildings")
wires_2 = BrepWireframe(Brep=scale_nu.Geometry, Density=-1)
gradxyz = Butterfly_GradingXYZ(xGrading=1, yGrading=multigrading, zGrading=multigrading_2)  # -> gradXYZ; plug-in component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
refinementregion = Butterfly_RefinementRegion(name="around_buildings_area", geo=flatten(scale_nu.Geometry), refMode=inoutrefmode)  # -> readMe, refinementRegion; plug-in component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
jagged = SettingsSpeed()
createbfgeometry = Butterfly_CreateButterflyGeometry(name=panel_5, geo=flatten(brep), boundary=wall, refineLevels="(4, 4)", meshSet=jagged)  # -> readMe, BFGeometries; plug-in component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
meshparams = Butterfly_MeshingParameters(cellSizeXYZ="{5,10,3}", gradXYZ=gradxyz, globRefineLevel="(2, 4)")  # -> readMe, meshParams; plug-in component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
tunnelparams = Butterfly_WindTunnelParameters(windwardX=3, topX=3, sidesX=2, leewardX=15)  # -> readMe, tunnelParams; plug-in component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
windvector = Butterfly_WindVector(windSpeed="6", windDirection=Point(0, 1, 0))  # -> windVector; plug-in component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
larger_than_90_to_get_the_hard_edges = Panel("castellatedMeshControls  {resolveFeatureAngle 95;}")

# ---- group: turn off the sanp to get the hard edges correctly
toggle = BooleanToggle(False)

# ----
python = GhPythonScript()  # -> out, a; disabled
# ---------- python: Python ----------
import butterfly
reload(butterfly)
reload(butterfly.case)
reload(butterfly.runmanager)

import butterfly_grasshopper
reload(butterfly_grasshopper)
# ---------- end python ----------
# 1. WIND TUNNEL
createcasefromtunnel = Butterfly_CreateCaseFromTunnel(
    name="outdoor_airflow",
    BFGeometries=flatten(createbfgeometry.BFGeometries),
    refRegions=refinementregion.refinementRegion,
    windVector=windvector,
    refWindHeight=10,
    landscape=6,
    meshParams=meshparams.meshParams,
    tunnelParams=tunnelparams.tunnelParams,
    run=Toggle(False))  # -> readMe, pts, case; plug-in component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
brep_2 = Brep([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])
item = ListItem(List=brep_2, Index=0, Wrap=True)
snappyhexmeshdict = Butterfly_snappyHexMeshDict(
    castellatedMesh=True,
    snap=toggle,
    addLayers=False,
    nCellsBetweenLevels=3,
    maxGlobalCells=2000000,
    surfaceFeatureLevel=Slider(3, range=0..10),
    expansionRatio=1.1,
    finalLayerThickness=0.7,
    minThickness=0.1,
    nLayerIter=50,
    additionalParameters=larger_than_90_to_get_the_hard_edges)  # -> snappyHexMeshDict; plug-in component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
toggle_2 = BooleanToggle(False)
gentestpts = Honeybee_GenerateTestPoints(testGeometry=item, gridSize="1", distBaseSrf="0.01", moveTestMesh=Toggle(False))  # -> readMe, simplify(testPoints), simplify(ptsVectors), simplify(facesArea), simplify(mesh); plug-in component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
pt = Point(createcasefromtunnel.pts)

# ---- group: sample the box in 3D
bbox_2 = BoundingBox(Plane=PlaneXY(0, 0, 0), UnionBox=True)  # -> Box, Box_2
range = Range(Domain=Domain(0.05, 0.95), Steps=10)
crossref = CrossReference(ListA=range, ListB=range, ListC=range, CrossMode=1)  # -> ListA, ListB, ListC
box = EvaluateBox(Box=bbox_2.Box, UParameter=crossref.ListA, VParameter=crossref.ListB, WParameter=crossref.ListC)  # -> Plane, Point, Include

# ----
# PURGE CASE
purgecase = Butterfly_purgeCase(case=createcasefromtunnel.case, blockMesh=False, snappyHexMesh=False, results=toggle_2, postProcessing=toggle_2)  # -> readMe; plug-in component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
panel_6 = Panel(createcasefromtunnel.readMe)
# 2.1. BLOCKMESH
blockmesh = Butterfly_blockMesh(case=createcasefromtunnel.case, overwrite=True, run=Toggle(False))  # -> readMe, case; plug-in component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
panel_7 = Panel("""p
U""")
flatten = FlattenTree(Tree=gentestpts.mesh, Path="{0}")
flatten_2 = FlattenTree(Tree=gentestpts.testPoints, Path="{0}")
panel_8 = Panel(purgecase)
relaxtionfactors = Butterfly_relaxtionFactors(quantities="U", values="0.0001")  # -> relaxationFactors; plug-in component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
controldict = Butterfly_controlDict(startTime=0, endTime="600", writeInterval=100, writeCompression=False, purgeWrite=0)  # -> controlDict; plug-in component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
residualcontrol = Butterfly_residualControl(quantities="U", values="0.0001")  # -> residualControl; plug-in component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
probes = Butterfly_probes(points=flatten_2, fields=panel_7)  # -> probes; plug-in component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
# 2. MESHING
# 2.2. SNAPPYHEXMESH
snappyhexmesh = Butterfly_snappyHexMesh(case=blockmesh.case, snappyHexMeshDict=snappyhexmeshdict, run=Toggle(False))  # -> readMe, case; plug-in component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
decomposepardict_scotch = Butterfly_decomposeParDictScotch(numOfCpus="2")  # -> decomposeParDict; plug-in component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
solutionparams = Butterfly_SolutionParameters(controlDict=controldict, probes=probes)  # -> solutionParams; plug-in component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
steadyincomp = Butterfly_SteadyIncompressibleRecipe()  # -> readMe, recipe; plug-in component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
# VISUALIZE MESH
loadmesh = Butterfly_LoadMesh(case=snappyhexmesh.case, innerMesh=False, load=Toggle(False))  # -> mesh; plug-in component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
# Solution should be converged in 561 iterations with default settings.
panel_9 = Panel("5")
# 3. SOLUTION
solution = Butterfly_Solution(
    case=snappyhexmesh.case,
    recipe=steadyincomp.recipe,
    solutionParams=solutionparams,
    interval=panel_9,
    write=Toggle(False),
    run=Toggle(False))  # -> readMe, solution, isRunning, timestep, residualFields, residualValues, logFiles; plug-in component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
panel_10 = Panel(solution.readMe)
preview = CustomPreview(Geometry=loadmesh, Shader=ColourSwatch(SwatchColor=RGBA(130, 80, 255, 100)))
loadprobesvalue = Butterfly_LoadProbesValue(solution=solution.solution, field="p")  # -> values; plug-in component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
loadprobesvalue_2 = Butterfly_LoadProbesValue(solution=solution.solution, field="U")  # -> values; plug-in component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
panel_11 = Panel(solution.residualValues)

# ---- group: points
pt_2 = Point(flatten_2)

# ---- group: vectors
vec = Vector(loadprobesvalue_2)

# ----
rec = Rectangle({Plane=PlaneXY(1, -6, 0), Size=Domain2(u=0..15, v=0..5)})
panel_12 = Panel("C:\Users\Mostapha\Documents\code\ladybug-tools\butterfly-plus\plugin\grasshopper")
# PLOT RESIDUALS
plotresiduals = Butterfly_PlotResiduals(solution=solution.solution, rect=rec, targetRes=0.0001, port=0.1, method=0, load=Toggle(False))  # -> readMe, timeRange, curves, port, residualLine, colors; plug-in component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
vlen = VectorLength(Vector=vec)
bnd = Bounds(Numbers=vlen)
gradientlibrary = Ladybug_GradientLibrary(gradIndex="7")  # -> customColors; plug-in component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
dedomain = DeconstructDomain(Domain=bnd)  # -> Start, End
panel_13 = Panel(bnd)
preview_2 = CustomPreview(Geometry=plotresiduals.curves, Shader=plotresiduals.colors)
panel_14 = Panel(plotresiduals.readMe)
gradient = Gradient(
    LowerLimit=dedomain.End,
    UpperLimit=dedomain.Start,
    Parameter=vlen,
    stops=[0: RGB(234, 38, 0), 0.25: RGB(234, 126, 0), 0.5: RGB(254, 244, 84), 0.75: RGB(173, 203, 249), 1: RGB(75, 107, 169)])
# 4. RESULT VISUALIZATION
mjoin = MeshJoin(Meshes=flatten)
legendpar = Ladybug_LegendParameters(customColors=flatten(gradientlibrary))  # -> legendPar; plug-in component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
exportladybug = Ladybug_ExportLadybug(components=plotresiduals.curves, targetFolder=panel_12, export=Toggle(False))  # -> readMe; plug-in component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
ladybug = Ladybug_Ladybug()  # -> Vviiiiiiiiiizzz; plug-in component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
scale = Slider(0.69, range=0..1)
recolormesh = Ladybug_RecolorMesh(analysisResult=loadprobesvalue, inputMesh=mjoin, legendPar=legendpar, analysisTitle="Pressure.", legendTitle="Pa.")  # -> readMe, newMesh, newLegend, legendBasePt, meshColors, legendColors; plug-in component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
swatch = ColourSwatch(SwatchColor=RGBA(39, 34, 25, 142))
multiplication = Multiplication(A=vec, B=scale)
faceb = FaceBoundaries(Mesh=recolormesh.newMesh)
mesh = Mesh(recolormesh.newLegend)
vdisex = VectorDisplayEx(Point=pt_2, Vector=multiplication, Colour=gradient, Width=Slider(2, range=0..5))
preview_3 = CustomPreview(Geometry=faceb, Shader=recolormesh.meshColors)
