# Grasshopper definition 01_1_outdoor_airflow_2d.gh (Grasshopper 1.0.7)

panel = Panel("""0.1
0.45
0.55""")
panel_2 = Panel("""0.5
0.5""")
panel_3 = Panel("""70
30""")
panel_4 = Panel("""20
60
20""")
seggrading = Butterfly_SegmentGrading(percentage_length=panel_2, percentage_cells=panel_3, expansion_ratio=1)  # -> segment_grading; plug-in component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
seggrading_2 = Butterfly_SegmentGrading(percentage_length=panel, percentage_cells=panel_4, expansion_ratio=1)  # -> segment_grading; plug-in component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
multigrading = Butterfly_MultiGrading(segment_gradings=flatten(seggrading))  # -> grading; plug-in component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
multigrading_2 = Butterfly_MultiGrading(segment_gradings=flatten(seggrading_2))  # -> grading; plug-in component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
gradxyz = Butterfly_GradingXYZ(x_grading=1, y_grading=multigrading_2, z_grading=multigrading)  # -> grad_xyz; plug-in component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

brep = Brep([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])

bbox = BoundingBox(Content=brep, Plane=PlaneXY(0, 0, 0), UnionBox=True)  # -> Box, Box_2
box = EvaluateBox(Box=bbox.Box_2, UParameter=0.5, VParameter="0.1", WParameter="0")  # -> Plane, Point, Include
number_slider = Slider(2, range=0..10)
number_slider_2 = Slider(2.4, range=0..10)
inoutrefmode = Butterfly_LocationRefinementMode(mode=0, level="3")  # -> location_ref_mode; plug-in component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
scale_nu = ScaleNU(Geometry=bbox.Box_2, Plane=box.Point, ScaleX=number_slider, ScaleY=number_slider, ScaleZ=number_slider)  # -> Geometry, Transform
refinementregion = Butterfly_RefinementRegion(name="around_buildings_area", geo=flatten(scale_nu.Geometry), ref_mode=inoutrefmode)  # -> report, ref_region; plug-in component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

# ----
# This file is set up in meters. If you're using a different units make sure to scale the input geometries.
wires = BrepWireframe(Brep=brep, Density=-1)

# ----
# 0. BUTTERFLY GEOMETRIES
wall = Butterfly_WallBoundary()  # -> wall_boundary; plug-in component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
jagged = SettingsSpeed()
createbfgeometry = Butterfly_CreateButterflyGeometry(name="buildings", geo=flatten(brep), boundary=wall, refine_levels="(5, 5)", mesh_set=jagged)  # -> report, BF_geo; plug-in component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

X = UnitX(Factor=1)
pt = Point(Point(20.71695441, 16.28911004, 5.023621839))
make2dparams = Butterfly_Make2dParameters(origin=pt, normal=X, width="1")  # -> report, make_2d_params; plug-in component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

windvector = Butterfly_WindVector(wind_speed="6", wind_direction=Point(0, 1, 0))  # -> wind_vector; plug-in component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

# ----
# 1. WIND TUNNEL
panel_5 = Panel("outdoor_airflow_2d")
createcasefromtunnel = Butterfly_CreateCaseFromTunnel(
    name=panel_5,
    BF_geo=flatten(createbfgeometry.BF_geo),
    ref_regions=refinementregion.ref_region,
    wind_vector=windvector,
    ref_wind_height=10,
    landscape=6,
    make_2d_params=make2dparams.make_2d_params,
    run=Toggle(False))  # -> report, block_pts, wind_tunnel, case; plug-in component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

pt_2 = Point(createcasefromtunnel.block_pts)
item = ListItem(List=pt_2, Index=0, Wrap=True)  # -> Item1, Item, Item1_2
pl = PlaneNormal(Origin=pt, ZAxis=X)
box_2 = Box2Pt(PointA=item.Item1, PointB=item.Item1_2, Plane=PlaneXY(0, 0, 0))
sec = BrepPlane(Brep=box_2, Plane=pl)  # -> Curves, Points
item_2 = ListItem(List=brep, Index=0, Wrap=True)
boundary = BoundarySurfaces(Edges=sec.Curves)
split = SplitBrep(Brep=boundary, Cutter=item_2)
item_3 = ListItem(List=split, Index=0, Wrap=True)
gentestpts = Honeybee_GenerateTestPoints(testGeometry=item_3, gridSize="1", distBaseSrf="0.01", moveTestMesh=Toggle(False))  # -> readMe, simplify(testPoints), simplify(ptsVectors), simplify(facesArea), simplify(mesh); plug-in component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
flatten = FlattenTree(Tree=gentestpts.mesh, Path="{0}")
flatten_2 = FlattenTree(Tree=gentestpts.testPoints, Path="{0}")

toggle = BooleanToggle(False)
# PURGE CASE
purgecase = Butterfly_purgeCase(case=createcasefromtunnel.case, block_mesh=toggle, snappy_hex_mesh=toggle, results=toggle, post_processing=toggle)  # -> report; plug-in component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

# ---- group: turn off the sanp to get the hard edges correctly
toggle_2 = BooleanToggle(False)

# ----
larger_than_90_to_get_the_hard_edges = Panel("castellatedMeshControls  {resolveFeatureAngle 95;}")
snappyhexmeshdict = Butterfly_snappyHexMeshDict(
    castellated_mesh=True,
    snap=toggle_2,
    add_layers=False,
    n_cells_btwn_levels=3,
    max_global_cells=2000000,
    expansion_ratio=1.1,
    final_layer_thickness=0.7,
    min_thickness=0.1,
    n_layer_iter=50,
    additional_par=larger_than_90_to_get_the_hard_edges)  # -> snappy_hex_mesh_dict; plug-in component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

panel_6 = Panel(purgecase)
# 2.1. BLOCKMESH
blockmesh = Butterfly_blockMesh(case=createcasefromtunnel.case, grad_xyz=gradxyz, overwrite=True, write=Toggle(False), run=Toggle(False))  # -> report, case; plug-in component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
panel_7 = Panel("""p
U""")
controldict = Butterfly_controlDict(start_time=0, end_time=Slider(5000, range=0..10000), write_interval=100, write_compression=False, purge_write=0)  # -> control_dict; plug-in component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
probes = Butterfly_probes(points=flatten_2, fields=panel_7)  # -> probes; plug-in component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
residualcontrol = Butterfly_residualControl(values=1e-05)  # -> residual_control; plug-in component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
# 2. MESHING
# 2.2. SNAPPYHEXMESH
snappyhexmesh = Butterfly_snappyHexMesh(case=blockmesh.case, snappy_hex_mesh_dict=snappyhexmeshdict, write=Toggle(False), run=Toggle(False))  # -> report, case; plug-in component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
decomposepardict_scotch = Butterfly_decomposeParDictScotch(num_of_cpus="4")  # -> decompose_par_dict; plug-in component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
solutionparams = Butterfly_SolutionParameters(control_dict=controldict, probes=probes)  # -> solution_par; plug-in component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
steadyincomp = Butterfly_SteadyIncompressibleRecipe()  # -> report, recipe; plug-in component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
# VISUALIZE MESH
loadmesh = Butterfly_LoadMesh(case=snappyhexmesh.case, inner_mesh=False, load=Toggle(False))  # -> mesh; plug-in component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
# Solution should be converged in 1467 iterations with default settings.
panel_8 = Panel("2")
# 3. SOLUTION
solution = Butterfly_Solution(
    case=snappyhexmesh.case,
    recipe=steadyincomp.recipe,
    solution_par=solutionparams,
    interval=panel_8,
    write=Toggle(False),
    run=Toggle(False))  # -> report, solution, is_running, timestep, residual_fields, residual_values, log_files; plug-in component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
panel_9 = Panel(solution.residual_fields)
loadprobesvalue = Butterfly_LoadProbesValue(solution=solution.solution, field="p")  # -> values; plug-in component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
loadprobesvalue_2 = Butterfly_LoadProbesValue(solution=solution.solution, field="U")  # -> values; plug-in component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
panel_10 = Panel(solution.residual_values)

rec = Rectangle({Plane=PlaneXY(1, -6, 0), Size=Domain2(u=0..15, v=0..5)})
# PLOT RESIDUALS
plotresiduals = Butterfly_PlotResiduals(solution=solution.solution, rect=rec, target_res=0.0001, port=0.1, method=0, load=Toggle(False))  # -> report, time_range, curves, port, residual_line, colors; plug-in component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
preview = CustomPreview(Geometry=plotresiduals.curves, Shader=plotresiduals.colors)

# ---- group: points
pt_3 = Point(flatten_2)

# ---- group: vectors
vec = Vector(loadprobesvalue_2)

# ----
vlen = VectorLength(Vector=vec)
bnd = Bounds(Numbers=vlen)
dedomain = DeconstructDomain(Domain=bnd)  # -> Start, End
gradient = Gradient(
    LowerLimit=dedomain.End,
    UpperLimit=dedomain.Start,
    Parameter=vlen,
    stops=[0: RGB(234, 38, 0), 0.25: RGB(234, 126, 0), 0.5: RGB(254, 244, 84), 0.75: RGB(173, 203, 249), 1: RGB(75, 107, 169)])
scale = Slider(0.69, range=0..1)
multiplication = Multiplication(A=vec, B=scale)
vdisex = VectorDisplayEx(Point=pt_3, Vector=multiplication, Colour=gradient, Width=Slider(2, range=0..5))

gradientlibrary = Ladybug_GradientLibrary(gradIndex="7")  # -> customColors; plug-in component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
# 4. RESULT VISUALIZATION
mjoin = MeshJoin(Meshes=flatten)
legendpar = Ladybug_LegendParameters(customColors=flatten(gradientlibrary))  # -> legendPar; plug-in component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
recolormesh = Ladybug_RecolorMesh(analysisResult=loadprobesvalue, inputMesh=mjoin, legendPar=legendpar, analysisTitle="Pressure.", legendTitle="Pa.")  # -> readMe, newMesh, newLegend, legendBasePt, meshColors, legendColors; plug-in component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
ladybug = Ladybug_Ladybug()  # -> Vviiiiiiiiiizzz; plug-in component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
faceb = FaceBoundaries(Mesh=recolormesh.newMesh)
mesh = Mesh(recolormesh.newLegend)
preview_2 = CustomPreview(Geometry=faceb, Shader=recolormesh.meshColors)

panel_11 = Panel(plotresiduals.report)
