# Grasshopper definition 02_1_indoor_airflow_2d.gh (Grasshopper 1.0.7)

vec = VectorXYZ(XComponent="1.2", YComponent=0, ZComponent=0)  # -> Vector, Length
outlet = Butterfly_OutletBoundary()  # -> outlet_boundary; plug-in component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
wall = Butterfly_WallBoundary()  # -> wall_boundary; plug-in component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
inletvel = Butterfly_InletBoundary(velocity_vec=vec.Vector)  # -> inlet_boundary; plug-in component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

# ---- group: Make 2D
Y = UnitY(Factor=1)
pt = Point(Point(4.51574388, 2.967695353, 3.602823551))
make2dparams = Butterfly_Make2dParameters(origin=pt, normal=Y, width="0.2")  # -> report, make_2d_params; plug-in component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

# ---- group: inlet!
srf = Surface(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)

# ---- group: walls
brep = Brep(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)

# ---- group: outlet
srf_2 = Surface([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])

# ----
# 0. CREATE BUTTERFLY SURFACES
area = Area(Geometry=srf)  # -> Area, Centroid
wires = BrepWireframe(Brep=brep, Density=-1)
preview = CustomPreview(Geometry=srf_2, Shader=ColourSwatch(SwatchColor=RGBA(255, 0, 255, 77)))
jagged = SettingsSpeed()
vdis = VectorDisplay(Anchor=area.Centroid, Vector=vec.Vector)
preview_2 = CustomPreview(Geometry=srf, Shader=ColourSwatch(SwatchColor=RGBA(136, 191, 255, 77)))

createbfgeometry = Butterfly_CreateButterflyGeometry(name="west_window", geo=flatten(srf), boundary=inletvel, mesh_set=jagged)  # -> report, BF_geo; plug-in component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
createbfgeometry_2 = Butterfly_CreateButterflyGeometry(name="room", geo=flatten(brep), boundary=wall, mesh_set=jagged)  # -> report, BF_geo; plug-in component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
createbfgeometry_3 = Butterfly_CreateButterflyGeometry(name="east_window", geo=flatten(srf_2), boundary=outlet, mesh_set=jagged)  # -> report, BF_geo; plug-in component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

# ---- group: turn off the sanp to get the hard edges correctly
toggle = BooleanToggle(False)

# ----
larger_than_90_to_get_the_hard_edges = Panel("castellatedMeshControls  {resolveFeatureAngle 95;}")
snappyhexmeshdict = Butterfly_snappyHexMeshDict(
    castellated_mesh=True,
    snap=toggle,
    add_layers=False,
    n_cells_btwn_levels=3,
    max_global_cells=2000000,
    expansion_ratio=1.1,
    final_layer_thickness=0.7,
    min_thickness=0.1,
    n_layer_iter=50,
    additional_par=larger_than_90_to_get_the_hard_edges)  # -> snappy_hex_mesh_dict; plug-in component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

# ----
# 1. CREATE OPENFOAM CASE
panel = Panel("indoor_airflow_2d")
casefromgeos = Butterfly_CreateCaseFromGeometries(
    name=panel,
    BF_geo=flatten([createbfgeometry_2.BF_geo, createbfgeometry_3.BF_geo, createbfgeometry.BF_geo]),
    make_2d_params=make2dparams.make_2d_params,
    expand_block_mesh=True,
    run=Toggle(False))  # -> report, block_pts, case; plug-in component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
toggle_2 = BooleanToggle(False)
panel_2 = Panel(casefromgeos.block_pts)
panel_3 = Panel(casefromgeos.report)
# PURGE CASE
purgecase = Butterfly_purgeCase(case=casefromgeos.case, block_mesh=toggle_2, snappy_hex_mesh=toggle_2, results=toggle_2, post_processing=toggle_2)  # -> report; plug-in component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
# 2.1. BLOCKMESH
blockmesh = Butterfly_blockMesh(case=casefromgeos.case, cell_count="{0.2, 0.2, 0.2}", overwrite=True, write=Toggle(False), run=Toggle(False))  # -> report, case; plug-in component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
brep_2 = Brep(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)
# 2. MESHING
# 2.2. SNAPPYHEXMESH
snappyhexmesh = Butterfly_snappyHexMesh(case=blockmesh.case, snappy_hex_mesh_dict=snappyhexmeshdict, write=Toggle(False), run=Toggle(False))  # -> report, case; plug-in component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
gentestpts = Honeybee_GenerateTestPoints(testGeometry=brep_2, gridSize=Slider(0.2, range=0..1), distBaseSrf="0.05", moveTestMesh=Toggle(False))  # -> readMe, simplify(testPoints), simplify(ptsVectors), simplify(facesArea), simplify(mesh); plug-in component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

# ---- group: update inlet wind velocity
panel_4 = Panel("""boundaryField
{

west_window
    {

  
value		uniform (1.5 0.0 0.0);

}
}""")
panel_5 = Panel("U")

# ----
flatten = FlattenTree(Tree=gentestpts.mesh, Path="{0}")
flatten_2 = FlattenTree(Tree=gentestpts.testPoints, Path="{0}")
panel_6 = Panel("""p
U""")
panel_7 = Panel(snappyhexmesh.report)
controldict = Butterfly_controlDict(start_time=0, end_time="5000", write_interval=100, write_compression=False, purge_write=0)  # -> control_dict; plug-in component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
decomposepardict_scotch = Butterfly_decomposeParDictScotch(num_of_cpus="2")  # -> decompose_par_dict; plug-in component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
probes = Butterfly_probes(points=flatten_2, fields=panel_6)  # -> probes; plug-in component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
solutionparam = Butterfly_SolutionParameter(filename=panel_5, values=panel_4, replace=False)  # -> solution_par; plug-in component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
# VISUALIZE MESH
loadmesh = Butterfly_LoadMesh(case=snappyhexmesh.case, inner_mesh=False, load=Toggle(True))  # -> mesh; plug-in component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
solutionparams = Butterfly_SolutionParameters(control_dict=controldict, probes=probes, additional_par=solutionparam)  # -> solution_par; plug-in component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
steadyincomp = Butterfly_SteadyIncompressibleRecipe()  # -> report, recipe; plug-in component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

# ----
# Solution should be converged in 398 iterations with default settings.
toggle_3 = BooleanToggle(False)

# ----
# 3. SOLUTION
solution = Butterfly_Solution(
    case=snappyhexmesh.case,
    recipe=steadyincomp.recipe,
    solution_par=solutionparams,
    interval=2,
    write=toggle_3,
    run=Toggle(False))  # -> report, solution, is_running, timestep, residual_fields, residual_values, log_files; plug-in component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
panel_8 = Panel(solution.residual_fields)
loadprobesvalue = Butterfly_LoadProbesValue(solution=solution.solution, field="p")  # -> values; plug-in component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
loadprobesvalue_2 = Butterfly_LoadProbesValue(solution=solution.solution, field="U")  # -> values; plug-in component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
panel_9 = Panel(solution.residual_values)

rec = Rectangle({Plane=PlaneXY(1, -6, 0), Size=Domain2(u=0..15, v=0..5)})
# PLOT RESIDUALS
plotresiduals = Butterfly_PlotResiduals(solution=solution.solution, rect=rec, target_res=0.0001, port=0.1, method=0, load=Toggle(False))  # -> report, time_range, curves, port, residual_line, colors; plug-in component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
preview_3 = CustomPreview(Geometry=plotresiduals.curves, Shader=plotresiduals.colors)
preview_4 = CustomPreview(
    Geometry=plotresiduals.residual_line,
    Shader={diffuse=RGB(255, 105, 180), emission=RGB(76, 32, 54), shine=0.5, specular=RGB(255, 255, 255), transparency=0})

# ---- group: points
pt_2 = Point(flatten_2)

# ---- group: vectors
vec_2 = Vector(loadprobesvalue_2)

# ----
vlen = VectorLength(Vector=vec_2)
bnd = Bounds(Numbers=vlen)
dedomain = DeconstructDomain(Domain=bnd)  # -> Start, End
gradient = Gradient(
    LowerLimit=dedomain.End,
    UpperLimit=dedomain.Start,
    Parameter=vlen,
    stops=[0: RGB(234, 38, 0), 0.25: RGB(234, 126, 0), 0.5: RGB(254, 244, 84), 0.75: RGB(173, 203, 249), 1: RGB(75, 107, 169)])
scale = Slider(0.11, range=0..1)
multiplication = Multiplication(A=vec_2, B=scale)
vdisex = VectorDisplayEx(Point=pt_2, Vector=multiplication, Colour=gradient, Width=Slider(2, range=0..5))

gradientlibrary = Ladybug_GradientLibrary(gradIndex="7")  # -> customColors; plug-in component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
# 4. RESULT VISUALIZATION
mjoin = MeshJoin(Meshes=flatten)
legendpar = Ladybug_LegendParameters(customColors=flatten(gradientlibrary))  # -> legendPar; plug-in component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
recolormesh = Ladybug_RecolorMesh(analysisResult=loadprobesvalue, inputMesh=mjoin, legendPar=legendpar, analysisTitle="Pressure.", legendTitle="Pa.")  # -> readMe, newMesh, newLegend, legendBasePt, meshColors, legendColors; plug-in component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
ladybug = Ladybug_Ladybug()  # -> Vviiiiiiiiiizzz; plug-in component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
faceb = FaceBoundaries(Mesh=recolormesh.newMesh)
mesh = Mesh(recolormesh.newLegend)
